# Grasshopper definition Laka-2x99-honeybee.gh (Grasshopper 1.0.8)

create_frame_element = HBPHCreatePHWindowFrameElement(name="Frame parameters")  # -> out, frame_element; plug-in component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
shademat = HBShadeMaterial(name="Window shader", thickness=Slider(0.05, range=0..0.1), transmittance=Slider(0.1, range=0..0.1))  # -> mat; plug-in component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
create_frame = HBPHCreatePHWindowFrame(
    name="Frame",
    top=create_frame_element.frame_element,
    right=create_frame_element.frame_element,
    bottom=create_frame_element.frame_element,
    left=create_frame_element.frame_element)  # -> out, frame; plug-in component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
create_glazing = HBPHCreatePHGlazing(name="Glazing", u_factor="0.62")  # -> out, glazing; plug-in component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
create_sd_const = HBPHCreateSDConstructions(const_names="roof", u_values="0.0946")  # -> out, hb_constructions; inputs const_names: list, u_values: list; plug-in component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
create_sd_const_2 = HBPHCreateSDConstructions(const_names="ground floor", u_values="0.284")  # -> out, hb_constructions; inputs const_names: list, u_values: list; plug-in component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
# Constructions
create_sd_const_3 = HBPHCreateSDConstructions(const_names="ext wall", u_values="0.142")  # -> out, hb_constructions; inputs const_names: list, u_values: list; plug-in component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
create_ph_win_const = HBPHCreatePHWindowConstruction(name="Window", frame=create_frame.frame, glazing=create_glazing.glazing, shade=shademat)  # -> out, construction; plug-in component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
subfacesubset = HBSubfaceSubset(window=create_ph_win_const.construction, glass_door=create_ph_win_const.construction)  # -> subface_set; plug-in component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
groundsubset = HBGroundConstructionSubset(ground_floor=create_sd_const_2.hb_constructions)  # -> ground_set; plug-in component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
exteriorsubset = HBExteriorConstructionSubset(exterior_wall=create_sd_const_3.hb_constructions, exterior_roof=create_sd_const.hb_constructions)  # -> exterior_set; plug-in component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
ph_foundation_types = HBPHFoundationTypes({"1-Heated Basement": 1, "2-Unheated Basement": 2, "3-Slab-On-Grade": 3, "4-Vented Crawlspace": 4, "5-None": 5}, selected="3-Slab-On-Grade")
constructionset = HBConstructionSet(exterior_subset=exteriorsubset, ground_subset=groundsubset, subface_subset=subfacesubset)  # -> constr_set; plug-in component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
create_foundation = HBPHCreateFoundation(
    type=ph_foundation_types,
    floor_slab_area_m2=Slider(99, range=0..100),
    floor_slab_u_value=Slider(0.3, range=0..1),
    floor_slab_exposed_perimeter_m=Slider(40, range=0..100))  # -> out, ph_foundation; inputs perim_insulation_position: Int32; plug-in component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
pipeline = GeometryPipeline(
    GroupByLayer=False,
    GroupByType=False,
    IncludeHidden=True,
    IncludeLocked=True,
    LayerFilter="Windows",
    NameFilter="*",
    SublayerFiltering=True,
    TypeFilter=1073741848)
pipeline_2 = GeometryPipeline(
    GroupByLayer=False,
    GroupByType=False,
    IncludeHidden=True,
    IncludeLocked=True,
    LayerFilter="Geometry",
    NameFilter="*",
    SublayerFiltering=True,
    TypeFilter=1073741848)
# GEOMETRY
roomsolid = HBRoomFromSolid(geo=flatten(pipeline_2), constr_set=constructionset, conditioned=True)  # -> report, rooms; plug-in component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
aperture = HBAperture(geo=pipeline)  # -> report, apertures; plug-in component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
solveadj = HBSolveAdjacency(rooms=flatten(roomsolid.rooms), run=Toggle(True))  # -> report, adj_rooms; plug-in component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
pipeline_3 = GeometryPipeline(
    GroupByLayer=False,
    GroupByType=False,
    IncludeHidden=True,
    IncludeLocked=True,
    LayerFilter="TermBri",
    NameFilter="*",
    SublayerFiltering=True,
    TypeFilter=1073741852)
addsubface = HBAddSubface(hb_obj=flatten(solveadj.adj_rooms), sub_faces=flatten(aperture.apertures))  # -> hb_obj; plug-in component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
panel = Panel("""1
1
1
1
1
1
0
1
1
1
1
1""")
add_foundations = HBPHAddFoundations(ph_foundations=create_foundation.ph_foundation, hb_rooms=addsubface)  # -> out, hb_rooms; inputs ph_foundations: list, hb_rooms: list; plug-in component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
create_thermal_bridges = HBPHCreateThermalBridges(geometry=pipeline_3, names="Thermal Bridges", quantities=Slider(2, range=0..10))  # -> out, thermal_bridges; inputs geometry: list of GeometryBase, names: list, psi_values: list, fRsi_values: list, types: list, quantities: list; plug-in component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
cfm_extract = Panel("""0
0
0.01
0.01
0
0
0
0.01
0.01
0.01
0.01
0.01""")
cfm_supply = Panel("""0.01
0.01
0
0
0.01
0.01
0.01
0
0
0
0
0""")
pipeline_4 = GeometryPipeline(
    GroupByLayer=False,
    GroupByType=False,
    IncludeHidden=True,
    IncludeLocked=True,
    LayerFilter="Rooms",
    NameFilter="*",
    SublayerFiltering=True,
    TypeFilter=1073741848)
graft = GraftTree(Tree=panel, IncludeEmptyLists=True, IncludeNullItems=True)
add_thermal_bridges = HBPHAddThermalBridgesToRooms(thermal_bridges=create_thermal_bridges.thermal_bridges, hb_rooms=add_foundations.hb_rooms)  # -> out, hb_rooms; inputs thermal_bridges: list, hb_rooms: list; plug-in component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
objdet = ObjectDetails(Object=pipeline_4)  # -> Referenced, Available, Name, Layer, Colour, Guid
panel_2 = Panel(objdet.Name)
create_space_ph_vent = HBPHCreateSpacePHVentilation(v_sup=simplify(cfm_supply), v_eta=simplify(cfm_extract))  # -> out, simplify(space_ph_vent); inputs v_sup: tree, v_eta: tree, v_tran: tree; plug-in component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
graft_2 = GraftTree(Tree=objdet.Name, IncludeEmptyLists=True, IncludeNullItems=True)
# SPACES
graft_3 = GraftTree(Tree=pipeline_4, IncludeEmptyLists=True, IncludeNullItems=True)
set_spec_heat_cap = HBPHSetSpecHeatCapacity(room_spec_capacities=Slider(3, range=0..10), hb_rooms=add_thermal_bridges.hb_rooms)  # -> out, hb_rooms; inputs room_spec_capacities: list, hb_rooms: list; plug-in component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
graft_4 = GraftTree(Tree=create_space_ph_vent.space_ph_vent, IncludeEmptyLists=True, IncludeNullItems=True)
create_ph_spaces = HBPHCreateSpaces(
    flr_seg_geom=simplify(graft_3),
    weighting_factors=simplify(graft),
    space_names=simplify(graft_2),
    space_ph_vent_rates=simplify(graft_4))  # -> out, error, floor_breps, volume_breps, spaces; inputs flr_seg_geom: tree of GeometryBase, weighting_factors: tree, volume_geometry: tree, volume_heights: tree, space_names: tree, space_numbers: tree, space_ph_vent_rates: tree, flr_seg_net_areas: tree; plug-in component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
add_ph_spaces = HBPHAddSpaces(spaces=create_ph_spaces.spaces, inherit_room_names=False, hb_rooms=set_spec_heat_cap.hb_rooms)  # -> out, check_pts, open_rooms, hb_rooms; inputs spaces: list, inherit_room_names: Boolean, hb_rooms: list; plug-in component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
ph_op_period = HBPHOperationPeriod(hours_per_day=Slider(22, range=0..100), operating_fraction=Slider(0.75, range=0..1))  # -> out, op_period; plug-in component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
# VENT SCH
ph_op_period_2 = HBPHOperationPeriod(hours_per_day=Slider(2, range=0..10), operating_fraction=Slider(1, range=0..1))  # -> out, op_period; plug-in component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
ph_vent_sched = HBPHVentSchedule(name="ventilation sched", op_period_high=ph_op_period_2.op_period, op_period_standard=ph_op_period.op_period)  # -> out, ventilation_sch; plug-in component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
applyroomsch = HBApplyRoomSchedules(room_or_program=flatten(add_ph_spaces.hb_rooms), ventilation_sch=ph_vent_sched.ventilation_sch)  # -> report, mod_obj; plug-in component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
hbph_cooling_types = HBPHCoolingTypes({"Ventilation Air": 1, "Recirculating Air": 2, "Dehumidification": 3, "Radiant Panel": 4}, selected="Radiant Panel")
pipeline_5 = GeometryPipeline(
    GroupByLayer=False,
    GroupByType=False,
    IncludeHidden=True,
    IncludeLocked=True,
    LayerFilter="ERV",
    NameFilter="*",
    SublayerFiltering=True,
    TypeFilter=1073741852)
hbph_heating_types = HBPHHeatingTypes({"Direct Electric": 1, "Boiler (Gas, Oil)": 2, "Boiler (Wood)": 3, "District Heating": 4, "Heat Pump (Annual)": 5, "Heat Pump (Monthly)": 6}, selected="Heat Pump (Annual)")
create_cooling_parameters = HBPHCreateCoolingParams(cooling_type=hbph_cooling_types, display_name="Ceiling cooler", annual_COP=Slider(3.3, range=0..10))  # -> out, cooling_params; plug-in component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
# MECHANICAL VENTILATION
hbph_vent_types = HBPHVentTypes({"1-Balanced PH ventilation with HR [Default]": "1", "2-Extract air unit": "2", "3-Only window ventilation": "3"}, selected="1-Balanced PH ventilation with HR [Default]")
create_duct = HBPHCreateVentilationDuct(geometry=pipeline_5, insul_thickness=Slider(50, range=0..100))  # -> out, vent_duct; inputs geometry: list of GeometryBase, insul_reflective: Boolean; plug-in component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
create_heating_cooling = HBPHCreateSpaceConditioningSystem(
    system_type=hbph_heating_types,
    display_name="Main Heat Pump",
    annual_COP=Slider(3.5, range=0..10),
    cooling_params_chilled_panel=create_cooling_parameters.cooling_params)  # -> out, space_conditioning_system; plug-in component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
ph_ventilator = HBPHVentilator(display_name="Zender ComfoAir Q600 ERV", sensible_hr="0.8", latent_hr="0.68", elec_efficiency="0.22")  # -> out, flatten(unit); inputs frost_protection: Boolean, inside: Boolean; plug-in component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
create_vent = HBPHCreateVentilationSystem(
    system_name="balanced PH with HR",
    system_type=hbph_vent_types,
    vent_unit=ph_ventilator.unit,
    duct_01=create_duct.vent_duct,
    duct_02=create_duct.vent_duct)  # -> out, vent_system; inputs duct_01: list, duct_02: list; plug-in component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
add_mech = HBPHAddMechSystems(
    ventilation_system=create_vent.vent_system,
    space_conditioning_systems=flatten(create_heating_cooling.space_conditioning_system),
    hb_rooms=applyroomsch.mod_obj)  # -> out, hb_rooms; inputs space_conditioning_systems: list, supportive_devices: list, hb_rooms: list; plug-in component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
hbph_shw_heater_types = HBPHSHWHeaterTypes({"Elec. Resistance": "1-Electric", "Boiler (gas/oil)": "2-Boiler (gas/oil)", "Boiler (wood)": "3-Boiler (wood)", "District Heating": "4-District", "Heat Pump (annual COP)": "5-HeatPump (annual COP)", "Heat Pump (monthly COP)": "6-HeatPump (monthly COP)", "Heat Pump (inside)": "7-HeatPump (inside)"}, selected="Heat Pump (annual COP)")
hbph_shw_pipe_material = HBPHSHWPipeMaterial({"1-COPPER_M": 1, "2-COPPER_L": 2, "3-COPPER_K": 3, "4-CPVC_CTS_SDR": 4, "5-CPVC_SCH_40": 5, "6-PEX": 6, "7-PE": 7, "8-PEX_CTS_SDR": 8}, selected="1-COPPER_M")
pipeline_6 = GeometryPipeline(
    GroupByLayer=False,
    GroupByType=False,
    IncludeHidden=True,
    IncludeLocked=True,
    LayerFilter="Pipe",
    NameFilter="*",
    SublayerFiltering=True,
    TypeFilter=1073741852)
hbph_shw_pipe_diameter = HBPHSHWPipeDiameter({"3/8": 1, "1/2": 2, "5/8": 3, "3/4": 4, "1": 5, "1-1/4": 6, "1-1/2": 7, "2": 8}, selected="1/2")
toggle = BooleanToggle(True)
hbph_shw_pipe_diameter_2 = HBPHSHWPipeDiameter({"3/8": 1, "1/2": 2, "5/8": 3, "3/4": 4, "1": 5, "1-1/4": 6, "1-1/2": 7, "2": 8}, selected="3/8")
pipeline_7 = GeometryPipeline(
    GroupByLayer=False,
    GroupByType=False,
    IncludeHidden=True,
    IncludeLocked=True,
    LayerFilter="Pipe",
    NameFilter="*",
    SublayerFiltering=True,
    TypeFilter=1073741852)
create_shw_tank = HBPHCreateSHWTank(tank_type=Slider(2, range=0..10), display_name="Hot Water", in_conditioned_space=toggle)  # -> out, storage_tank; inputs quantity: Int32, for_solar: Boolean, in_conditioned_space: Boolean; plug-in component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
create_recirc_pipes = HBPHCreateSHWRecirculationPipes(geometry=pipeline_6, name="Hot Water", diameter=hbph_shw_pipe_diameter)  # -> out, flatten(dhw_recirc_piping); inputs geometry: list of GeometryBase, name: list, diameter: list, insul_thickness: list, insul_conductivity: list, insul_reflective: list of Boolean, insul_quality: list, daily_period: list, water_temp: list; plug-in component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
# HOT WATER
create_shw_heater = HBPHCreateSHWHeater(
    heater_type=hbph_shw_heater_types,
    display_name="Hot Water",
    in_conditioned_space=toggle,
    annual_COP=Slider(3.3, range=0..10),
    total_system_perf_ratio=Slider(0.7, range=0..1))  # -> out, heater; inputs in_conditioned_space: Boolean; plug-in component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
create_trunk_pipes = HBPHCreateSHWPipeTrunks(display_name="pipe", material=hbph_shw_pipe_material, diameter=hbph_shw_pipe_diameter_2, geometry=pipeline_7)  # -> out, dhw_trunk_piping; inputs dhw_branches: list, multiplier: list of Int32, display_name: list, demand_recirculation: list of Boolean, material: list, diameter: list, water_temp: list, geometry: list of GeometryBase; plug-in component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
create_shw_sys = HBPHCreateSHWSystem(
    name="Hot Water",
    tank_1=create_shw_tank.storage_tank,
    heaters=create_shw_heater.heater,
    distribution_piping=create_trunk_pipes.dhw_trunk_piping,
    recirc_piping=create_recirc_pipes.dhw_recirc_piping)  # -> out, hb_shw; inputs heaters: list, distribution_piping: list, num_tap_points: Int32, recirc_piping: list; plug-in component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
apply_shw_sys = HBPHApplySHWSystem(hb_shw=create_shw_sys.hb_shw, hb_rooms=add_mech.hb_rooms)  # -> out, flatten(hb_rooms); inputs hb_rooms: list; plug-in component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
bang = ExplodeTree(Data=graft(apply_shw_sys.hb_rooms))  # -> simplify(Branch0), simplify(Branch1)
# Occupancy
set_res_occupancy = HBPHSetResOccupancy(
    num_bedrooms=simplify(Slider(2, range=0..10)),
    num_dwellings=simplify(Slider(1, range=0..10)),
    num_people=simplify(Slider(3, range=0..10)),
    hb_rooms=simplify(bang.Branch0))  # -> out, hb_rooms; inputs num_bedrooms: tree of Int32, num_dwellings: tree of Int32, num_people: tree of Int32, hb_rooms: tree; plug-in component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
merge = Merge(Data1=set_res_occupancy.hb_rooms, Data2=bang.Branch1)  # -> flatten(Result)
# Appliances
panel_3 = Panel("1")
add_ph_equipment = HBPHAddPHEquipment(phius_defaults=panel_3, hb_rooms=merge)  # -> out, flatten(hb_rooms); inputs phius_defaults: Int32, phi_defaults: Int32, equipment: list, hb_rooms: list; plug-in component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
number_slider = Slider(10, range=0..10)
# SEGMENT
path = FilePath("Z:\Laka99\DOVER_AFB_DE-mon.txt")
phi_cert = HBPHPHICertification(
    phpp_version=Slider(10, range=0..10),
    building_use_type=number_slider,
    certification_type=number_slider,
    retrofit=Slider(1, range=0..1))  # -> out, phi_certification; inputs phpp_version: Int32; plug-in component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
create_site_from_file = HBPHCreateSiteFromPhiusFile(source_file_path=path)  # -> out, site; plug-in component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
ph_bldg_segment = HBPHBldgSegment(
    segment_name="Full house segment",
    num_floor_levels=Slider(2, range=0..10),
    num_dwelling_units=Slider(1, range=0..1),
    site=create_site_from_file.site,
    phi_certification=phi_cert.phi_certification,
    hb_rooms=simplify(flatten(add_ph_equipment.hb_rooms)))  # -> out, hb_rooms; inputs num_floor_levels: Int32, num_dwelling_units: Int32, source_energy_factors: list, co2e_factors: list, hb_rooms: list; plug-in component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
pipeline_8 = GeometryPipeline(
    GroupByLayer=False,
    GroupByType=False,
    IncludeHidden=True,
    IncludeLocked=True,
    LayerFilter="Shading",
    NameFilter="*",
    SublayerFiltering=True,
    TypeFilter=1073741848)
shade = HBShade(geo=pipeline_8, name="Shade")  # -> report, shades; plug-in component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
# EXPORT
panel_4 = Panel("Laka99")
model = HBModel(rooms=flatten(ph_bldg_segment.hb_rooms), shades=flatten(shade.shades), name=panel_4)  # -> report, model; plug-in component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
path_2 = FilePath("Z:\Laka99\")
team_member = HBPHCreateProjectTeamMember(name="Zlatan Dimitrov", city="Burgas")  # -> out, team_member; plug-in component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
set_project_data = HBPHSetModelProjectData(owner=team_member.team_member, designer=team_member.team_member, model=model.model)  # -> out, model; plug-in component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
dumpobjects = HBDumpObjects(hb_objs=flatten(set_project_data.model), name="laka99_hbjson", folder=path_2, dump=Toggle(True))  # -> report, hb_file; plug-in component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
write_wufi_xml = HBPHWriteWUFIXML(filename=panel_4, save_folder=path_2, hb_json_file=dumpobjects.hb_file, write_xml=Toggle(True))  # -> out, xml_file; plug-in component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
